# Grasshopper definition a4-scaled-octopus.gh (Grasshopper 1.0.7)

og_octopus = Geometry([<mesh referenced from the Rhino model> x44])

# ---- group: rivet
rivet_diameter = Number(Slider(6.09, range=0..5000))
number = Number(0.5)
multiplication = Multiplication(A=rivet_diameter, B=number)
circle = Circle(Plane=PlaneXY(0, 0, 0), Radius=multiplication)
rivet_hole = Geometry(circle)

# ----
crank_shaft_length = Number(Slider(100, range=0..5000))
crank_shaft_width = Number(Slider(7.5, range=0..5000))
scale = Scale(Geometry=og_octopus, Center=Point(0, 0, 0), Factor=Slider(0.75, range=0..1))  # -> Geometry, Transform
rectangle = Rectangle(Plane=PlaneXY(0, 0, 0), XSize=crank_shaft_length, YSize=crank_shaft_width, Radius=0)  # -> Rectangle, Length
md_slider = MDSlider(
    SliderMode=0,
    slider_value=Point(0.4640514095, 0.4730384641, 0.5),
    x_domain=Domain(-1000, 1000),
    y_domain=Domain(-1000, 1000),
    z_domain=Domain(0, 1))
move = Move(Geometry=scale.Geometry, Motion=md_slider)  # -> Geometry, Transform
egg_thing = Geometry()
scaled_octopus = Geometry(move.Geometry)
crank_shaft = Geometry()
