# Grasshopper definition mold-squared [May-19 '19, 1049].gh (Grasshopper 0.9.80)

slider = Slider(3.75, range=0..10)
slider_2 = Slider(3.85, range=0..10)
secondary_tile = Geometry(<brep referenced from the Rhino model>)
primary_tile = Geometry(<brep referenced from the Rhino model>)
dom = Domain(DomainStart=expr("-x/2", slider), DomainEnd=expr("x/2", slider))
dom_2 = Domain(DomainStart=expr("-x/2", slider_2), DomainEnd=expr("x/2", slider_2))
primary_tile_2 = Geometry(primary_tile)
cavity_width_height = Number(Slider(37.406, range=0..200))
total_height = Number(Slider(38.1, range=0..200))
cavity_depth = Number(Slider(20, range=0..200))
total_width = Number(Slider(76.026, range=0..200))
total_length = Number(Slider(177.8, range=0..200))
slider_3 = Slider(3.75, range=0..10)
slider_4 = Slider(3.85, range=0..10)
rectangle = Rectangle(Plane=PlaneXY(0, 0, 0), XSize=dom, YSize=dom_2, Radius=0)  # -> Rectangle, Length
dom_3 = Domain(DomainStart=expr("-x/2", slider_3), DomainEnd=expr("x/2", slider_3))
dom_4 = Domain(DomainStart=expr("-x/2", slider_4), DomainEnd=expr("x/2", slider_4))
dom_5 = Domain(DomainStart=expr("-x/2", total_width), DomainEnd=expr("x/2", total_width))
dom_6 = Domain(DomainStart=expr("-x/2", total_length), DomainEnd=expr("x/2", total_length))
rectangle_2 = Rectangle(Plane=PlaneXY(0, 0, 0), XSize=dom_3, YSize=dom_4, Radius=0)  # -> Rectangle, Length
dom_7 = Domain(DomainStart=expr("-x/2", cavity_width_height), DomainEnd=expr("x/2", cavity_width_height))
subtraction = Subtraction(A=total_height, B=cavity_depth)
subtraction_2 = Subtraction(A=total_width, B=cavity_width_height)
domain_box = DomainBox(Base=PlaneXY(0, 0, 0), X=dom_6, Y=dom_5, Z=total_height)
domain_box_2 = DomainBox(Base=PlaneXY(0, 0, 0), X=dom_7, Y=dom_7, Z=cavity_depth)
number = Number(expr("1/2", 0.5))
multiplication = Multiplication(A=number, B=subtraction_2)
machinable_wax_block = Geometry(domain_box)
vector_xyz = VectorXYZ(XComponent=Slider(50, range=0..200), YComponent=multiplication, ZComponent=subtraction)  # -> Vector, Length
move = Move(Geometry=primary_tile_2, Motion=vector_xyz.Vector)  # -> Geometry, Transform
move_2 = Move(Geometry=domain_box_2, Motion=vector_xyz.Vector)  # -> Geometry, Transform
solid_difference = SolidDifference(BrepsA=machinable_wax_block, BrepsB=move_2.Geometry)
merge = Merge(Data2=move.Geometry)
mesh_join = MeshJoin(Meshes=merge)
geometry = Geometry(solid_difference)

# ---- group: preview
md_slider = MDSlider(
    slider_value=Point(0.7791621511, 0.8099121466, 0.5),
    SliderMode=0,
    x_domain=Domain(-300, 300),
    y_domain=Domain(-300, 300),
    z_domain=Domain(0, 1))
final = Geometry(geometry)
move_3 = Move(Geometry=final, Motion=md_slider)  # -> Geometry, Transform
preview = Geometry(move_3.Geometry)
