# Grasshopper definition mold-squared.gh (Grasshopper 0.9.80)

geometry = Geometry(<brep referenced from the Rhino model>)
primary_tile_with_details = Geometry(<brep referenced from the Rhino model>)
geometry_2 = Geometry(<brep referenced from the Rhino model>)
slider = Slider(3.75, range=0..10)
slider_2 = Slider(3.85, range=0..10)
secondary_tile = Geometry(<brep referenced from the Rhino model>)
primary_tile = Geometry(<brep referenced from the Rhino model>)
number = Number(expr("1/2", 0.5))
dom = Domain(DomainStart=expr("-x/2", slider), DomainEnd=expr("x/2", slider))
dom_2 = Domain(DomainStart=expr("-x/2", slider_2), DomainEnd=expr("x/2", slider_2))
primary_tile_2 = Geometry(primary_tile_with_details)
cavity_width_height = Number(Slider(63.404, range=0..200))
total_height = Number(Slider(38.1, range=0..200))
cavity_depth = Number(Slider(20, range=0..200))
total_width = Number(Slider(76.026, range=0..200))
total_length = Number(Slider(177.8, range=0..200))
move = Move(Geometry=geometry, Motion=Vector(0, 0, 10))  # -> Geometry, Transform
slider_3 = Slider(3.75, range=0..10)
slider_4 = Slider(3.85, range=0..10)
orient = Orient(Geometry=primary_tile_2, Source=PlaneXY(0, 0, 0), Target=PlaneXY(0, 0, 0))  # -> Geometry, Transform
rectangle = Rectangle(Plane=PlaneXY(0, 0, 0), XSize=dom, YSize=dom_2, Radius=0)  # -> Rectangle, Length
dom_3 = Domain(DomainStart=expr("-x/2", slider_3), DomainEnd=expr("x/2", slider_3))
dom_4 = Domain(DomainStart=expr("-x/2", slider_4), DomainEnd=expr("x/2", slider_4))
dom_5 = Domain(DomainStart=expr("-x/2", total_width), DomainEnd=expr("x/2", total_width))
dom_6 = Domain(DomainStart=expr("-x/2", total_length), DomainEnd=expr("x/2", total_length))

# ---- group: preview
md_slider = MDSlider(
    slider_value=Point(0.2906523914, 0.263943742, 0.5),
    SliderMode=0,
    x_domain=Domain(-300, 300),
    y_domain=Domain(-300, 300),
    z_domain=Domain(0, 1))
final = Geometry(geometry)
move_2 = Move(Geometry=final, Motion=md_slider)  # -> Geometry, Transform
preview = Geometry(move_2.Geometry)

# ----
rectangle_2 = Rectangle(Plane=PlaneXY(0, 0, 0), XSize=dom_3, YSize=dom_4, Radius=0)  # -> Rectangle, Length
dom_7 = Domain(DomainStart=expr("-x/2", cavity_width_height), DomainEnd=expr("x/2", cavity_width_height))
subtraction = Subtraction(A=total_height, B=cavity_depth)
domain_box = DomainBox(Base=PlaneXY(0, 0, 0), X=dom_6, Y=dom_5, Z=total_height)
domain_box_2 = DomainBox(Base=PlaneXY(0, 0, 0), X=dom_7, Y=dom_7, Z=cavity_depth)
machinable_wax_block = Geometry(domain_box)
vector_xyz = VectorXYZ(XComponent=Slider(-49.658, range=-100..100), YComponent=0, ZComponent=subtraction)  # -> Vector, Length
move_3 = Move(Geometry=domain_box_2, Motion=vector_xyz.Vector)  # -> Geometry, Transform
move_4 = Move(Geometry=primary_tile_2, Motion=vector_xyz.Vector)  # -> Geometry, Transform
solid_difference = SolidDifference(BrepsA=machinable_wax_block, BrepsB=move_3.Geometry)
merge = Merge(Data1=solid_difference, Data2=move_4.Geometry)
brep_join = BrepJoin(Breps=merge)  # -> Breps, Closed
geometry_3 = Geometry(solid_difference)

# ---- group: preview
md_slider_2 = MDSlider(
    slider_value=Point(0.7791621511, 0.8099121466, 0.5),
    SliderMode=0,
    x_domain=Domain(-300, 300),
    y_domain=Domain(-300, 300),
    z_domain=Domain(0, 1))
final_2 = Geometry(geometry_3)
move_5 = Move(Geometry=final_2, Motion=md_slider_2)  # -> Geometry, Transform
preview_2 = Geometry(move_5.Geometry)
