# Grasshopper definition tile.gh (Grasshopper 0.9.80)

tiny_planet_radius = Number(Slider(15.845, range=0..100))
detail_depth = Number(Slider(9.208, range=0..100))
main_square_height_width = Number(Slider(40, range=0..100))
tile_base_thickness = Number(Slider(10, range=0..100))
tiny_planet_radius_2 = Number(tiny_planet_radius)
tile_base_thickness_2 = Number(tile_base_thickness)

# ---- group: primary tile base / offset squares
main_square_height_width_2 = Number(main_square_height_width)
tile_base_thickness_3 = Number(tile_base_thickness)
construct_domain = Domain(DomainStart=expr("-x/2", main_square_height_width_2), DomainEnd=expr("x/2", main_square_height_width_2))
rectangle = Rectangle(Plane=PlaneXY(0, 0, 0), XSize=construct_domain, YSize=construct_domain, Radius=0)  # -> Rectangle, Length
duplicate_data = DuplicateData(Data=rectangle.Rectangle, Number=2, Order=True)
pi = Pi(Factor=Slider(0.25, range=0..1))
rotate = Rotate(Geometry=duplicate_data, Angle=pi, Plane=PlaneXY(0, 0, 0))  # -> Geometry, Transform

# ---- group: tiny planet
main_square_height_width_3 = Number(main_square_height_width)
sqrt_2_1_2 = Number(expr("(sqrt(2)-1)/2", 0.4142135624))
detail_depth_2 = Number(detail_depth)
tile_base_thickness_4 = Number(tile_base_thickness)
multiplication = Multiplication(A=main_square_height_width_3, B=sqrt_2_1_2)
base_square = Geometry(rectangle.Rectangle)
polygon_center = PolygonCenter(Polyline=base_square)  # -> CenterV, CenterE, CenterA
circle_cnr = CircleCNR(Center=polygon_center.CenterA, Normal=Vector(0, 0, 1), Radius=multiplication)
vector_xyz = VectorXYZ(XComponent=0, YComponent=0, ZComponent=tile_base_thickness_4)  # -> Vector, Length
move = Move(Geometry=circle_cnr, Motion=vector_xyz.Vector)  # -> Geometry, Transform
number = Number(-1)
multiplication_2 = Multiplication(A=detail_depth_2, B=number)
vector_xyz_2 = VectorXYZ(XComponent=0, YComponent=0, ZComponent=multiplication_2)  # -> Vector, Length
extrude = Extrude(Base=move.Geometry, Direction=vector_xyz_2.Vector)
tiny_planet = Geometry(extrude)

# ---- group: primary tile base / circular caps
main_square_height_width_4 = Number(main_square_height_width)
multiplication_3 = Multiplication(A=main_square_height_width_4, B=Slider(0.5, range=0..1))
vector_xyz_3 = VectorXYZ(XComponent=multiplication_3, YComponent=0, ZComponent=0)  # -> Vector, Length
duplicate_data_2 = DuplicateData(Data=circle_cnr, Number=2, Order=True)
multiplication_4 = Multiplication(A=main_square_height_width_4, B=Slider(-0.5, range=-1..1))
move_2 = Move(Geometry=duplicate_data_2, Motion=vector_xyz_3.Vector)  # -> Geometry, Transform
vector_xyz_4 = VectorXYZ(XComponent=multiplication_4, YComponent=0, ZComponent=0)  # -> Vector, Length
duplicate_data_3 = DuplicateData(Data=duplicate_data_2, Number=2, Order=True)
move_3 = Move(Geometry=duplicate_data_3, Motion=vector_xyz_4.Vector)  # -> Geometry, Transform
circular_cap_2 = Geometry(move_3.Geometry)
circular_cap_1 = Geometry(move_2.Geometry)

# ---- group: primary tile base / joining primitive shapes
solid_intersection = SolidIntersection(BrepsA=rectangle.Rectangle, BrepsB=rotate.Geometry)
solid_intersection_2 = SolidIntersection(BrepsA=solid_intersection, BrepsB=circular_cap_1)
solid_intersection_3 = SolidIntersection(BrepsA=solid_intersection_2, BrepsB=circular_cap_2)
vector_xyz_5 = VectorXYZ(XComponent=0, YComponent=0, ZComponent=tile_base_thickness_3)  # -> Vector, Length
extrude_2 = Extrude(Base=solid_intersection_3, Direction=vector_xyz_5.Vector)
cap_holes = CapHoles(Brep=extrude_2)

# ----
merge = Merge(Data1=tiny_planet)
details = Geometry(merge)

# ---- group: primary tile base
primary_tile_base = Geometry(cap_holes)

# ---- group: secondary tile base
main_square_height_width_5 = Number(main_square_height_width)
tile_base_thickness_5 = Number(tile_base_thickness)
sqrt_2 = Number(1.414213562)
number_slider = Slider(2, range=0..10)
multiplication_5 = Multiplication(A=main_square_height_width_5, B=sqrt_2)
base_tile = Geometry(primary_tile_base)
rectangle_2 = Rectangle(Plane=PlaneXY(0, 0, 0), XSize=multiplication_5, YSize=multiplication_5, Radius=0)  # -> Rectangle, Length
rectangular_array = RectangularArray(Geometry=base_tile, Cell=rectangle_2.Rectangle, XCount=number_slider, YCount=number_slider)  # -> Geometry, Transform
vector_xyz_6 = VectorXYZ(XComponent=0, YComponent=0, ZComponent=tile_base_thickness_5)  # -> Vector, Length
secondary_tile_bounding_box = Geometry(rectangle_2.Rectangle)
brep_join = BrepJoin(Breps=rectangular_array.Geometry)  # -> Breps, Closed
extrude_3 = Extrude(Base=secondary_tile_bounding_box, Direction=vector_xyz_6.Vector)
array = Geometry(brep_join.Breps)
cap_holes_2 = CapHoles(Brep=extrude_3)
solid_difference = SolidDifference(BrepsA=cap_holes_2, BrepsB=array)
secondary_tile_base = Geometry(solid_difference)
base_tile_2 = Geometry(secondary_tile_base)  # disabled
rectangular_array_2 = RectangularArray(Geometry=base_tile_2, Cell=rectangle_2.Rectangle, XCount=number_slider, YCount=number_slider)  # -> Geometry, Transform
brep_join_2 = BrepJoin(Breps=rectangular_array_2.Geometry)  # -> Breps, Closed
secondary_tilearray = Geometry(brep_join_2.Breps)

# ----
solid_difference_2 = SolidDifference(BrepsA=primary_tile_base, BrepsB=details)
tile_1 = Geometry(solid_difference_2)

# ---- group: preview
md_slider = MDSlider(
    slider_value=Point(0.3450458806, 0.2672681111, 0.5),
    SliderMode=0,
    x_domain=Domain(-300, 300),
    y_domain=Domain(-300, 300),
    z_domain=Domain(0, 1))
final = Geometry(primary_tile_base)
move_4 = Move(Geometry=final, Motion=md_slider)  # -> Geometry, Transform
preview = Geometry(move_4.Geometry)
