# Grasshopper definition lampshade-design.gh (Grasshopper 1.0.7)

geometry = Geometry(<brep referenced from the Rhino model>)
plane_surface = PlaneSurface(Plane=PlaneXY(0, 0, 0), XSize=Slider(2, range=0..200), YSize=Slider(400, range=0..400))
number = Number(0.25)
pi = Pi(Factor=number)
rotate = Rotate(Geometry=geometry, Angle=pi, Plane=PlaneXY(0, 0, 0))  # -> Geometry, Transform
plane_surface_2 = PlaneSurface(Plane=PlaneXY(0, 0, 0), XSize=Slider(2, range=0..200), YSize=Slider(400, range=0..400))
series = Series(Start=Slider(0, range=-20..20), Step=Slider(1, range=-20..20), Count=Slider(25, range=-20..50))
square = Square(Value=series)
vector_xyz = VectorXYZ(XComponent=Slider(20, range=0..400), YComponent=0, ZComponent=0)  # -> Vector, Length
multiplication = Multiplication(A=square, B=Slider(-4, range=-20..20))
multiplication_2 = Multiplication(A=series, B=Slider(14, range=-20..20))
linear_array = LinearArray(Geometry=plane_surface_2, Direction=vector_xyz.Vector, Count=Slider(20, range=0..400))  # -> Geometry, Transform; disabled
merge = Merge(Data1=multiplication, Data2=multiplication_2)
vector_xyz_2 = VectorXYZ(XComponent=multiplication_2, YComponent=0, ZComponent=0)  # -> Vector, Length
move = Move(Geometry=geometry, Motion=vector_xyz_2.Vector)  # -> Geometry, Transform

border = Number(Slider(20, range=0..200))
lampshade_inner_diameter = Number(Slider(90, range=0..200))
lampshade_outer_diameter = Number(Slider(120, range=0..200))
lampshade_height = Number(Slider(200, range=0..200))
pi_2 = Pi(Factor=lampshade_outer_diameter)
pi_3 = Pi(Factor=lampshade_inner_diameter)
addition = Addition(A=border, B=pi_3)
addition_2 = Addition(A=border, B=lampshade_height)
_2 = Number(-2)
plane_surface_3 = PlaneSurface(Plane=PlaneXY(0, 0, 0), XSize=addition, YSize=addition_2)
division = Division(A=border, B=_2)
vector_xyz_3 = VectorXYZ(XComponent=division, YComponent=division, ZComponent=0)  # -> Vector, Length
move_2 = Move(Geometry=plane_surface_3, Motion=vector_xyz_3.Vector)  # -> Geometry, Transform
plane_surface_4 = PlaneSurface(Plane=PlaneXY(0, 0, 0), XSize=pi_3, YSize=lampshade_height)
region_intersection = RegionIntersection(CurvesA=linear_array.Geometry, CurvesB=plane_surface_4)  # disabled

plane_surface_5 = PlaneSurface(Plane=PlaneXY(0, 0, 0), XSize=addition, YSize=Slider(30, range=0..200))
number_2 = Number(-1)
vector_xyz_4 = VectorXYZ(XComponent=division, YComponent=Slider(-35.833, range=-50..50), ZComponent=0)  # -> Vector, Length
move_3 = Move(Geometry=plane_surface_5, Motion=vector_xyz_4.Vector)  # -> Geometry, Transform

region_intersection_2 = RegionIntersection(CurvesA=move.Geometry, CurvesB=plane_surface_4)

region_difference = RegionDifference(CurvesA=move_2.Geometry, CurvesB=region_intersection_2)

region_difference_2 = RegionDifference(CurvesA=move_2.Geometry, CurvesB=region_intersection_2)

md_slider = MDSlider(
    SliderMode=0,
    slider_value=Point(0.8229779499, 0.9700038259, 0.5),
    x_domain=Domain(-1000, 1000),
    y_domain=Domain(-1000, 1000),
    z_domain=Domain(0, 1))
move_4 = Move(Geometry=region_difference_2, Motion=md_slider)  # -> Geometry, Transform
preview = Geometry(move_4.Geometry)
