# Grasshopper definition gauge.gh (Grasshopper 1.0.7)

# ---- group: slot gauge v2
adjusted_width_of_cardboard = Number(Slider(0.05, range=0..1))
value_list = ValueList({"0.004", "0.25", "2"}, selected="0.004")
value_list_2 = ValueList({"0.004", "0.25", "2"}, selected="0.004")
value_list_3 = ValueList({"0.25", "2"}, selected="0.25")
value_list_4 = ValueList({"0.25", "2"}, selected="0.25")
value_list_5 = ValueList({"0.25", "2", "0.33"}, selected="0.25")
subtraction = Subtraction(A=adjusted_width_of_cardboard, B=value_list)
addition = Addition(A=value_list_2, B=adjusted_width_of_cardboard)
rectangle = Rectangle(Plane=PlaneXY(0, 0, 0), XSize=adjusted_width_of_cardboard, YSize=value_list_3, Radius=0)  # -> Rectangle, Length
rectangle_2 = Rectangle(Plane=PlaneXY(0, 0, 0), XSize=subtraction, YSize=value_list_4, Radius=0)  # -> Rectangle, Length
rectangle_3 = Rectangle(Plane=PlaneXY(0, 0, 0), XSize=addition, YSize=value_list_5, Radius=0)  # -> Rectangle, Length
value_list_6 = ValueList({"0.004", "0.25", "0.5", "0.75", "2"}, selected="2")
value_list_7 = ValueList({"0.004", "0.25", "0.5", "0.75", "2"}, selected="2")
value_list_8 = ValueList({"0.004", "0.25", "0.5", "0.75", "2"}, selected="2")
value_list_9 = ValueList({"0.004", "0.2", "0.25", "0.33", "0.5", "0.75", "2"}, selected="0.2")
value_list_10 = ValueList({"0.004", "0.25", "0.5", "0.67", "0.75", "0.8", "2"}, selected="0.8")
division = Division(A=addition, B=value_list_6)
value_list_11 = ValueList({"0.004", "0.25", "0.5", "0.75", "2"}, selected="0.5")
division_2 = Division(A=adjusted_width_of_cardboard, B=value_list_7)
division_3 = Division(A=subtraction, B=value_list_8)
subtraction_2 = Subtraction(A=value_list_9, B=division)
subtraction_3 = Subtraction(A=value_list_11, B=division_2)
subtraction_4 = Subtraction(A=value_list_10, B=division_3)
vector_xyz = VectorXYZ(XComponent=subtraction_2, YComponent=0, ZComponent=0)  # -> Vector, Length
vector_xyz_2 = VectorXYZ(XComponent=subtraction_3, YComponent=0, ZComponent=0)  # -> Vector, Length
move = Move(Geometry=rectangle.Rectangle, Motion=vector_xyz_2.Vector)  # -> Geometry, Transform
vector_xyz_3 = VectorXYZ(XComponent=subtraction_4, YComponent=0, ZComponent=0)  # -> Vector, Length
move_2 = Move(Geometry=rectangle_2.Rectangle, Motion=vector_xyz_3.Vector)  # -> Geometry, Transform
move_3 = Move(Geometry=rectangle_3.Rectangle, Motion=vector_xyz.Vector)  # -> Geometry, Transform

adjusted_width_of_cardboard_2x = Number(Slider(0.1, range=0..1))
value_list_12 = ValueList({"0.004", "0.008", "0.25", "2"}, selected="0.008")
value_list_13 = ValueList({"0.004", "0.008", "0.25", "2"}, selected="0.008")
value_list_14 = ValueList({"0.25", "2"}, selected="0.25")
value_list_15 = ValueList({"0.25", "2"}, selected="0.25")
value_list_16 = ValueList({"0.25", "2", "0.33"}, selected="0.25")
subtraction_5 = Subtraction(A=adjusted_width_of_cardboard_2x, B=value_list_12)
addition_2 = Addition(A=value_list_13, B=adjusted_width_of_cardboard_2x)
rectangle_4 = Rectangle(Plane=PlaneXY(0, 0, 0), XSize=adjusted_width_of_cardboard_2x, YSize=value_list_14, Radius=0)  # -> Rectangle, Length
rectangle_5 = Rectangle(Plane=PlaneXY(0, 0, 0), XSize=subtraction_5, YSize=value_list_15, Radius=0)  # -> Rectangle, Length
rectangle_6 = Rectangle(Plane=PlaneXY(0, 0, 0), XSize=addition_2, YSize=value_list_16, Radius=0)  # -> Rectangle, Length
value_list_17 = ValueList({"0.004", "0.25", "0.5", "0.75", "2"}, selected="2")
value_list_18 = ValueList({"0.004", "0.25", "0.5", "0.75", "2"}, selected="2")
value_list_19 = ValueList({"0.004", "0.25", "0.5", "0.75", "2"}, selected="2")
value_list_20 = ValueList({"0.004", "0.25", "0.5", "0.67", "0.75", "0.8", "2"}, selected="0.8")
division_4 = Division(A=addition_2, B=value_list_17)
value_list_21 = ValueList({"0.004", "0.2", "0.25", "0.33", "0.5", "0.75", "2"}, selected="0.2")
value_list_22 = ValueList({"0.004", "0.25", "0.5", "0.75", "2"}, selected="0.5")
division_5 = Division(A=adjusted_width_of_cardboard_2x, B=value_list_18)
division_6 = Division(A=subtraction_5, B=value_list_19)
subtraction_6 = Subtraction(A=value_list_20, B=division_4)
subtraction_7 = Subtraction(A=value_list_22, B=division_5)
subtraction_8 = Subtraction(A=value_list_21, B=division_6)
vector_xyz_4 = VectorXYZ(XComponent=subtraction_6, YComponent=0, ZComponent=0)  # -> Vector, Length
vector_xyz_5 = VectorXYZ(XComponent=subtraction_7, YComponent=0, ZComponent=0)  # -> Vector, Length
move_4 = Move(Geometry=rectangle_4.Rectangle, Motion=vector_xyz_5.Vector)  # -> Geometry, Transform
vector_xyz_6 = VectorXYZ(XComponent=subtraction_8, YComponent=0, ZComponent=0)  # -> Vector, Length
move_5 = Move(Geometry=rectangle_5.Rectangle, Motion=vector_xyz_6.Vector)  # -> Geometry, Transform
move_6 = Move(Geometry=rectangle_6.Rectangle, Motion=vector_xyz_4.Vector)  # -> Geometry, Transform

# ---- group: slot gauge v1
slot_width_3 = Slider(0.112, range=0..1)
offset_3 = Slider(0.55, range=0..1)
base_height = Slider(1, range=0..3)
slot_width_2 = Slider(0.108, range=0..1)
offset_2 = Slider(0.35, range=0..1)
base_width = Slider(1, range=0..3)
slot_width_1 = Slider(0.104, range=0..1)
offset_1 = Slider(0.15, range=0..1)
offset_4 = Slider(0.75, range=0..1)
slot_width_4 = Slider(0.116, range=0..1)
slot_height = Slider(0.25, range=0..1)
rectangle_7 = Rectangle(Plane=PlaneXY(0, 0, 0), XSize=slot_width_1, YSize=slot_height, Radius=0)  # -> Rectangle, Length
rectangle_8 = Rectangle(Plane=PlaneXY(0, 0, 0), XSize=slot_width_4, YSize=slot_height, Radius=0)  # -> Rectangle, Length
rectangle_9 = Rectangle(Plane=PlaneXY(0, 0, 0), XSize=slot_width_3, YSize=slot_height, Radius=0)  # -> Rectangle, Length
rectangle_10 = Rectangle(Plane=PlaneXY(0, 0, 0), XSize=slot_width_2, YSize=slot_height, Radius=0)  # -> Rectangle, Length
vector_xyz_7 = VectorXYZ(XComponent=offset_4, YComponent=0, ZComponent=0)  # -> Vector, Length
vector_xyz_8 = VectorXYZ(XComponent=offset_3, YComponent=0, ZComponent=0)  # -> Vector, Length
vector_xyz_9 = VectorXYZ(XComponent=offset_2, YComponent=0, ZComponent=0)  # -> Vector, Length
vector_xyz_10 = VectorXYZ(XComponent=offset_1, YComponent=0, ZComponent=0)  # -> Vector, Length
rectangle_rounded_corner = Slider(0.128, range=0..3)
move_7 = Move(Geometry=rectangle_8.Rectangle, Motion=vector_xyz_7.Vector)  # -> Geometry, Transform
move_8 = Move(Geometry=rectangle_9.Rectangle, Motion=vector_xyz_8.Vector)  # -> Geometry, Transform
move_9 = Move(Geometry=rectangle_10.Rectangle, Motion=vector_xyz_9.Vector)  # -> Geometry, Transform
move_10 = Move(Geometry=rectangle_7.Rectangle, Motion=vector_xyz_10.Vector)  # -> Geometry, Transform
rectangle_11 = Rectangle(Plane=PlaneXY(0, 0, 0), XSize=base_width, YSize=base_height, Radius=rectangle_rounded_corner)  # -> Rectangle, Length
geometry = Geometry(move_7.Geometry)
geometry_2 = Geometry(move_8.Geometry)
geometry_3 = Geometry(move_9.Geometry)
polygon_radius = Slider(0.1, range=0..1)
segments = Slider(3, range=0..3)
geometry_4 = Geometry(move_10.Geometry)
n = Slider(2, range=0..3)
y = Slider(0.5, range=0..1)
division_7 = Division(A=polygon_radius, B=n)
base = Geometry(rectangle_11.Rectangle)
polygon = Polygon(Plane=PlaneXY(0, 0, 0), Radius=polygon_radius, Segments=segments, FilletRadius=0)  # -> Polygon, Length
region_difference = RegionDifference(CurvesA=base, CurvesB=geometry_4)
region_difference_2 = RegionDifference(CurvesA=region_difference, CurvesB=geometry_3)
region_difference_3 = RegionDifference(CurvesA=region_difference_2, CurvesB=geometry_2)
region_difference_4 = RegionDifference(CurvesA=region_difference_3, CurvesB=geometry)
vector_xyz_11 = VectorXYZ(XComponent=division_7, YComponent=y, ZComponent=0)  # -> Vector, Length
move_11 = Move(Geometry=polygon.Polygon, Motion=vector_xyz_11.Vector)  # -> Geometry, Transform
md_slider = MDSlider(
    SliderMode=0,
    slider_value=Point(0.5483480314, 0.7613108565, 0.5),
    x_domain=Domain(-10, 10),
    y_domain=Domain(-10, 10),
    z_domain=Domain(0, 1))
region_difference_5 = RegionDifference(CurvesA=region_difference_4, CurvesB=move_11.Geometry)
move_12 = Move(Geometry=region_difference_5, Motion=md_slider)  # -> Geometry, Transform
final_gauge = Geometry(move_12.Geometry)

# ---- group: test square with scoring
value_list_23 = ValueList({"0.004", "0.25", "1", "2"}, selected="1")
rectangle_12 = Rectangle(Plane=PlaneXY(0, 0, 0), XSize=value_list_23, YSize=value_list_23, Radius=0)  # -> Rectangle, Length
point = Point(Point(1, 1, 0))
origin = Point(Point(0, 0, 0))
line = Line(StartPoint=origin, EndPoint=point)
value_list_24 = ValueList({"0.004", "0.25", "1", "2", "3", "6"}, selected="6")
value_list_25 = ValueList({"0.004", "0.25", "0.5", "1", "2", "3", "6"}, selected="0.5")
polar_array = PolarArray(Geometry=line, Plane=PlaneXY(0, 0, 0), Count=value_list_24, Angle=6.283185307)  # -> Geometry, Transform
vector_xyz_12 = VectorXYZ(XComponent=value_list_25, YComponent=value_list_25, ZComponent=0)  # -> Vector, Length
move_13 = Move(Geometry=polar_array.Geometry, Motion=vector_xyz_12.Vector)  # -> Geometry, Transform
trim_with_region = TrimWithRegion(Curve=move_13.Geometry, Region=rectangle_12.Rectangle)  # -> Inside, Outside
square = Geometry(rectangle_12.Rectangle)
score = Geometry(trim_with_region.Inside)
merge = Merge(Data1=score, Data2=square)

# ---- group: slot gauge v2 / notch - mark side with smaller slots
value_list_26 = ValueList({"0.004", "0.05", "0.1", "0.25", "1", "2"}, selected="0.1")
circle = Circle(Plane=PlaneXY(0, 0, 0), Radius=value_list_26)
value_list_27 = ValueList({"0.004", "0.1", "0.25", "0.5", "1", "2"}, selected="0.5")
vector_xyz_13 = VectorXYZ(XComponent=0, YComponent=value_list_27, ZComponent=0)  # -> Vector, Length
move_14 = Move(Geometry=circle, Motion=vector_xyz_13.Vector)  # -> Geometry, Transform
circle_2 = Geometry(move_14.Geometry)

# ---- group: slot gauge v2
value_list_28 = ValueList({"0.004", "0.25", "1", "2"}, selected="1")
rectangle_13 = Rectangle(Plane=PlaneXY(0, 0, 0), XSize=value_list_28, YSize=value_list_28, Radius=0)  # -> Rectangle, Length
merge_2 = Merge(Data1=move_6.Geometry, Data2=move_4.Geometry, Data3=move_5.Geometry)
value_list_29 = ValueList({"0.004", "0.2", "0.25", "0.33", "0.5", "0.75", "2"}, selected="0.75")
vector_xyz_14 = VectorXYZ(XComponent=0, YComponent=value_list_29, ZComponent=0)  # -> Vector, Length
move_15 = Move(Geometry=merge_2, Motion=vector_xyz_14.Vector)  # -> Geometry, Transform
merge_3 = Merge(Data1=circle_2, Data2=move_3.Geometry, Data3=move.Geometry, Data4=move_2.Geometry, Data5=move_15.Geometry)
region_difference_6 = RegionDifference(CurvesA=rectangle_13.Rectangle, CurvesB=merge_3)

# ---- group: test square with scoring / offset preview
md_slider_2 = MDSlider(
    SliderMode=0,
    slider_value=Point(0.6791716785, 0.7616348267, 0.5),
    x_domain=Domain(-10, 10),
    y_domain=Domain(-10, 10),
    z_domain=Domain(0, 1))
move_16 = Move(Geometry=merge, Motion=md_slider_2)  # -> Geometry, Transform
final = Geometry(move_16.Geometry)

# ---- group: slot gauge v2 / offset preview
md_slider_3 = MDSlider(
    SliderMode=0,
    slider_value=Point(0.6110140172, 0.7628730216, 0.5),
    x_domain=Domain(-10, 10),
    y_domain=Domain(-10, 10),
    z_domain=Domain(0, 1))
move_17 = Move(Geometry=region_difference_6, Motion=md_slider_3)  # -> Geometry, Transform
final_2 = Geometry(move_17.Geometry)
