# Grasshopper definition lamp.gh (Grasshopper 1.0.7)

# ---- group: all parameters
number_slider = Slider(80, range=0..100)
cardboard_thickness_mm = Number(Slider(2.8, range=0..100))
bracket_arm_width_mm = Number(Slider(5, range=0..360))
bracket_arm_height_mm = Number(Slider(2, range=0..360))
box_length_mm = Number(number_slider)
bracket_angle_deg = Number(Slider(250, range=0..360))
bracket_height_mm = Number(Slider(5, range=0..360))
box_width_mm = Number(number_slider)
clamp_radius_mm = Number(Slider(6.5, range=0..100))
clamp_thickness = Number(Slider(1, range=0..360))
box_height_mm = Number(Slider(100, range=0..100))

# ---- group: cross supports
number_slider_2 = Slider(0.8, range=0..1)
multiplication = Multiplication(A=box_length_mm, B=number_slider_2)
number = Number(0.6666666667)
multiplication_2 = Multiplication(A=box_length_mm, B=number_slider_2)
addition = Addition(A=bracket_arm_width_mm, B=multiplication)
_1_2 = Number(-0.5)
_1_2_2 = Number(-0.5)
multiplication_3 = Multiplication(A=addition, B=_1_2_2)
rectangle = Rectangle(Plane=PlaneXY(0, 0, 0), XSize=multiplication_2, YSize=multiplication_2, Radius=0)  # -> Rectangle, Length
multiplication_4 = Multiplication(A=multiplication_2, B=_1_2)
rectangle_2 = Rectangle(Plane=PlaneXY(0, 0, 0), XSize=addition, YSize=addition, Radius=0)  # -> Rectangle, Length
vector_xyz = VectorXYZ(XComponent=multiplication_3, YComponent=multiplication_3, ZComponent=0)  # -> Vector, Length
vector_xyz_2 = VectorXYZ(XComponent=multiplication_4, YComponent=multiplication_4, ZComponent=0)  # -> Vector, Length
move = Move(Geometry=rectangle.Rectangle, Motion=vector_xyz_2.Vector)  # -> Geometry, Transform
move_2 = Move(Geometry=rectangle_2.Rectangle, Motion=vector_xyz.Vector)  # -> Geometry, Transform
box_rectangle = BoxRectangle(Rectangle=move_2.Geometry, Height=bracket_arm_height_mm)
box_rectangle_2 = BoxRectangle(Rectangle=move.Geometry, Height=bracket_arm_height_mm)
solid_difference = SolidDifference(BrepsA=box_rectangle, BrepsB=box_rectangle_2)
cross_supports = Geometry(solid_difference)

# ---- group: lamp base + cardboard width
cardboard_thickness_mm_2 = Number(cardboard_thickness_mm)
box_width_mm_2 = Number(box_length_mm)
addition_2 = Addition(A=box_width_mm_2, B=cardboard_thickness_mm_2)
_1_2_3 = Number(-0.5)
rectangle_3 = Rectangle(Plane=PlaneXY(0, 0, 0), XSize=addition_2, YSize=addition_2, Radius=0)  # -> Rectangle, Length
multiplication_5 = Multiplication(A=addition_2, B=_1_2_3)
vector_xyz_3 = VectorXYZ(XComponent=multiplication_5, YComponent=multiplication_5, ZComponent=0)  # -> Vector, Length
move_3 = Move(Geometry=rectangle_3.Rectangle, Motion=vector_xyz_3.Vector)  # -> Geometry, Transform
lamp_base_cardboard_width = Geometry(move_3.Geometry)

# ---- group: diagonal braces
_1_2_4 = Number(-0.5)
rectangle_4 = Rectangle(Plane=PlaneXY(0, 0, 0), XSize=Slider(65.774, range=0..360), YSize=bracket_arm_width_mm, Radius=0)  # -> Rectangle, Length
multiplication_6 = Multiplication(A=bracket_arm_width_mm, B=_1_2_4)
vector_xyz_4 = VectorXYZ(XComponent=0, YComponent=multiplication_6, ZComponent=0)  # -> Vector, Length
move_4 = Move(Geometry=rectangle_4.Rectangle, Motion=vector_xyz_4.Vector)  # -> Geometry, Transform
_270_360_2pi = Number(4.71238898)
normal_bracket_arms = Geometry(move_4.Geometry)
weird_bracket_arm = Geometry(move_4.Geometry)
_3 = Number(3)
rotate = Slider(315, range=0..360)
rotate_2 = Slider(45, range=0..360)
polar_array = PolarArray(Geometry=normal_bracket_arms, Plane=PlaneXY(0, 0, 0), Count=_3, Angle=_270_360_2pi)  # -> Geometry, Transform
_2pi_360 = Number(0.01745329252)
_2pi_360_2 = Number(0.01745329252)
multiplication_7 = Multiplication(A=_2pi_360, B=rotate)
rotate_3 = Rotate(Geometry=weird_bracket_arm, Angle=multiplication_7, Plane=PlaneXY(0, 0, 0))  # -> Geometry, Transform
multiplication_8 = Multiplication(A=_2pi_360_2, B=rotate_2)
rotate_4 = Rotate(Geometry=polar_array.Geometry, Angle=multiplication_8, Plane=PlaneXY(0, 0, 0))  # -> Geometry, Transform
region_difference = RegionDifference(CurvesA=rotate_3.Geometry, CurvesB=move.Geometry)
merge = Merge(Data1=rotate_4.Geometry, Data2=region_difference)
relay = Relay()  # disabled
unit_z = Vector(Vector(0, 0, 1))
region_intersection = RegionIntersection(CurvesA=merge, CurvesB=lamp_base_cardboard_width)
addition_3 = Addition(A=clamp_radius_mm, B=relay)
amplitude = Amplitude(Vector=unit_z, Amplitude=bracket_arm_height_mm)
circle = Circle(Plane=PlaneXY(0, 0, 0), Radius=addition_3)
region_difference_2 = RegionDifference(CurvesA=region_intersection, CurvesB=circle)
extrude = Extrude(Base=region_difference_2, Direction=amplitude)
cap_holes = CapHoles(Brep=extrude)
diagonal_braces = Geometry(cap_holes)

# ---- group: bracket ring
addition_4 = Addition(A=clamp_thickness, B=clamp_radius_mm)
_2pi_360_3 = Number(0.01745329252)
multiplication_9 = Multiplication(A=bracket_angle_deg, B=_2pi_360_3)
arc = Arc(Plane=PlaneXY(0, 0, 0), Radius=clamp_radius_mm, Angle=multiplication_9)  # -> Arc, Length
arc_2 = Arc(Plane=PlaneXY(0, 0, 0), Radius=addition_4, Angle=multiplication_9)  # -> Arc, Length
edge_surface = EdgeSurface(CurveA=arc_2.Arc, CurveB=arc.Arc)
unit_z_2 = Vector(Vector(0, 0, 1))
amplitude_2 = Amplitude(Vector=unit_z_2, Amplitude=bracket_height_mm)
rotate_5 = Slider(15, range=0..360)
extrude_2 = Extrude(Base=edge_surface, Direction=amplitude_2)
_2pi_360_4 = Number(0.01745329252)
multiplication_10 = Multiplication(A=_2pi_360_4, B=rotate_5)
rotate_6 = Rotate(Geometry=extrude_2, Angle=multiplication_10, Plane=PlaneXY(0, 0, 0))  # -> Geometry, Transform
bracket_ring_test_piece = Geometry(rotate_6.Geometry)

# ---- group: thickness of cardboard
addition_5 = Addition(A=cardboard_thickness_mm, B=box_length_mm)
addition_6 = Addition(A=cardboard_thickness_mm, B=box_width_mm)
addition_7 = Addition(A=cardboard_thickness_mm, B=box_height_mm)
_0_5 = Number(-0.5)
_0_5_2 = Number(-0.5)
_0_5_3 = Number(-0.5)
multiplication_11 = Multiplication(A=cardboard_thickness_mm, B=_0_5)
multiplication_12 = Multiplication(A=addition_6, B=_0_5_2)
multiplication_13 = Multiplication(A=addition_5, B=_0_5_3)
vector_xyz_5 = VectorXYZ(XComponent=multiplication_13, YComponent=multiplication_12, ZComponent=multiplication_11)  # -> Vector, Length
domain_box = DomainBox(Base=PlaneXY(0, 0, 0), X=addition_5, Y=addition_6, Z=addition_7)
move_5 = Move(Geometry=domain_box, Motion=vector_xyz_5.Vector)  # -> Geometry, Transform
outer_cardboard_thickness = Geometry(move_5.Geometry)

# ----
addition_8 = Addition(A=addition_6, B=cardboard_thickness_mm)
addition_9 = Addition(A=addition_5, B=cardboard_thickness_mm)
domain_box_2 = DomainBox(Base=PlaneXY(0, 0, 0), X=addition_9, Y=addition_8, Z=Slider(10, range=0..10))
_0_5_4 = Number(-0.5)
_0_5_5 = Number(-0.5)
_0_5_6 = Number(-0.5)
multiplication_14 = Multiplication(A=cardboard_thickness_mm, B=_0_5_4)
multiplication_15 = Multiplication(A=addition_8, B=_0_5_5)
multiplication_16 = Multiplication(A=addition_9, B=_0_5_6)
vector_xyz_6 = VectorXYZ(XComponent=multiplication_16, YComponent=multiplication_15, ZComponent=multiplication_14)  # -> Vector, Length
move_6 = Move(Geometry=domain_box_2, Motion=vector_xyz_6.Vector)  # -> Geometry, Transform
thingy_at_the_bottom = Geometry(move_6.Geometry)

# ---- group: cardbox board
domain_box_3 = DomainBox(Base=PlaneXY(0, 0, 0), X=box_length_mm, Y=box_width_mm, Z=box_height_mm)
_0_5_7 = Number(-0.5)
_0_5_8 = Number(-0.5)
multiplication_17 = Multiplication(A=box_width_mm, B=_0_5_7)
multiplication_18 = Multiplication(A=box_length_mm, B=_0_5_8)
vector_xyz_7 = VectorXYZ(XComponent=multiplication_18, YComponent=multiplication_17, ZComponent=0)  # -> Vector, Length
move_7 = Move(Geometry=domain_box_3, Motion=vector_xyz_7.Vector)  # -> Geometry, Transform
cardboard_box = Geometry(move_7.Geometry)

# ----
merge_2 = Merge(Data1=diagonal_braces, Data2=cross_supports, Data3=bracket_ring_test_piece)
solid_union = SolidUnion(Breps=merge_2)
lamp_bracket_3d_printed = Geometry(solid_union)

merge_3 = Merge(Data1=cardboard_box, Data2=outer_cardboard_thickness, Data3=thingy_at_the_bottom)
bracket = Geometry(lamp_bracket_3d_printed)
z_offset = Number(-5)
solid_difference_2 = SolidDifference(BrepsA=cardboard_box, BrepsB=bracket)
vector_xyz_8 = VectorXYZ(XComponent=0, YComponent=0, ZComponent=z_offset)  # -> Vector, Length
move_8 = Move(Geometry=merge_3, Motion=vector_xyz_8.Vector)  # -> Geometry, Transform
geometry = Geometry(solid_difference_2)
lamp_laser_cut_cardboard = Geometry(move_8.Geometry)

# ---- group: preview
md_slider = MDSlider(
    SliderMode=0,
    slider_value=Point(0.5848865044, 0.5154387311, 0.5),
    x_domain=Domain(-1000, 1000),
    y_domain=Domain(-1000, 1000),
    z_domain=Domain(0, 1))
final = Geometry(lamp_laser_cut_cardboard)
move_9 = Move(Geometry=final, Motion=md_slider)  # -> Geometry, Transform

# ----
final_2 = Geometry(lamp_bracket_3d_printed)
_2pi_360_5 = Number(0.01745329252)
rotate_7 = Slider(0, range=0..360)
multiplication_19 = Multiplication(A=rotate_7, B=_2pi_360_5)
rotate_8 = Rotate(Geometry=final_2, Angle=multiplication_19, Plane=PlaneXY(0, 0, 0))  # -> Geometry, Transform
md_slider_2 = MDSlider(
    SliderMode=0,
    slider_value=Point(0.4238534323, 0.5070419312, 0.5),
    x_domain=Domain(-1000, 1000),
    y_domain=Domain(-1000, 1000),
    z_domain=Domain(0, 1))
move_10 = Move(Geometry=rotate_8.Geometry, Motion=md_slider_2)  # -> Geometry, Transform
