# Grasshopper definition lampshade-design.gh (Grasshopper 1.0.7)

# ---- group: main
border = Number(Slider(20, range=0..200))
lampshade_inner_diameter = Number(Slider(90, range=0..200))
lampshade_outer_diameter = Number(Slider(120, range=0..200))
lampshade_height = Number(Slider(200, range=0..200))
pi = Pi(Factor=lampshade_outer_diameter)
pi_2 = Pi(Factor=lampshade_inner_diameter)
addition = Addition(A=border, B=pi_2)
addition_2 = Addition(A=border, B=lampshade_height)
_2 = Number(-2)
plane_surface = PlaneSurface(Plane=PlaneXY(0, 0, 0), XSize=addition, YSize=addition_2)
division = Division(A=border, B=_2)
vector_xyz = VectorXYZ(XComponent=division, YComponent=division, ZComponent=0)  # -> Vector, Length
move = Move(Geometry=plane_surface, Motion=vector_xyz.Vector)  # -> Geometry, Transform
plane_surface_2 = PlaneSurface(Plane=PlaneXY(0, 0, 0), XSize=pi_2, YSize=lampshade_height)
region_intersection = RegionIntersection(CurvesB=plane_surface_2)  # disabled

# ---- group: pattern
geo_to_repeat = Geometry(<brep referenced from the Rhino model>)
number = Number(0.25)
pi_3 = Pi(Factor=number)
rotate = Rotate(Geometry=geo_to_repeat, Angle=pi_3, Plane=PlaneXY(0, 0, 0))  # -> Geometry, Transform
plane_surface_3 = PlaneSurface(Plane=PlaneXY(0, 0, 0), XSize=Slider(2, range=0..200), YSize=Slider(400, range=0..400))
series = Series(Start=Slider(0, range=-20..20), Step=Slider(1, range=-20..20), Count=Slider(25, range=-20..50))
square = Square(Value=series)
multiplication = Multiplication(A=series, B=Slider(14, range=-20..20))
multiplication_2 = Multiplication(A=square, B=Slider(-4, range=-20..20))
merge = Merge(Data1=multiplication_2, Data2=multiplication)
vector_xyz_2 = VectorXYZ(XComponent=multiplication, YComponent=0, ZComponent=0)  # -> Vector, Length
move_2 = Move(Geometry=geo_to_repeat, Motion=vector_xyz_2.Vector)  # -> Geometry, Transform

# ---- group: top tabs
plane_surface_4 = PlaneSurface(Plane=PlaneXY(0, 0, 0), XSize=addition, YSize=Slider(30, range=0..200))
number_2 = Number(-1)
vector_xyz_3 = VectorXYZ(XComponent=division, YComponent=Slider(-35.833, range=-50..50), ZComponent=0)  # -> Vector, Length
move_3 = Move(Geometry=plane_surface_4, Motion=vector_xyz_3.Vector)  # -> Geometry, Transform

# ----
region_intersection_2 = RegionIntersection(CurvesA=move_2.Geometry, CurvesB=plane_surface_2)
region_difference = RegionDifference(CurvesA=move.Geometry, CurvesB=region_intersection_2)

# ---- group: preview
md_slider = MDSlider(
    SliderMode=0,
    slider_value=Point(0.7254169743, 0.5126867527, 0.5),
    x_domain=Domain(-1000, 1000),
    y_domain=Domain(-1000, 1000),
    z_domain=Domain(0, 1))
move_4 = Move(Geometry=region_difference, Motion=md_slider)  # -> Geometry, Transform
preview = Geometry(move_4.Geometry)
