# Grasshopper definition base.gh (Grasshopper 1.0.7)

# ---- group: base
circle_radius = Slider(0.75, range=0..5)
slot_width = Slider(0.112, range=0..5)
slot_height = Slider(0.25, range=0..5)
multiply = Slider(-0.5, range=-5..5)
x = Slider(3, range=0..5)
subtraction = Subtraction(A=circle_radius, B=slot_height)
multiplication = Multiplication(A=slot_width, B=multiply)
circle = Circle(Plane=PlaneXY(0, 0, 0), Radius=circle_radius)
rectangle = Rectangle(Plane=PlaneXY(0, 0, 0), XSize=slot_width, YSize=slot_height, Radius=0)  # -> Rectangle, Length
slot = Geometry(rectangle.Rectangle)
vector_xyz = VectorXYZ(XComponent=multiplication, YComponent=subtraction, ZComponent=0)  # -> Vector, Length
move = Move(Geometry=slot, Motion=vector_xyz.Vector)  # -> Geometry, Transform
number_of_slots = Slider(3, range=0..10)
polar_array = PolarArray(Geometry=move.Geometry, Plane=PlaneXY(0, 0, 0), Count=number_of_slots, Angle=6.283185307)  # -> Geometry, Transform
main_circle = Geometry(circle)
slots = Geometry(polar_array.Geometry)
region_difference = RegionDifference(CurvesA=main_circle, CurvesB=slots)
final = Geometry(region_difference)

circle_radius_2 = Slider(0.75, range=0..5)
slot_width_2 = Slider(0.224, range=0..5)
slot_height_2 = Slider(0.25, range=0..5)
multiply_2 = Slider(-0.5, range=-5..5)
x_2 = Slider(3, range=0..5)
subtraction_2 = Subtraction(A=circle_radius_2, B=slot_height_2)
multiplication_2 = Multiplication(A=slot_width_2, B=multiply_2)
circle_2 = Circle(Plane=PlaneXY(0, 0, 0), Radius=circle_radius_2)
rectangle_2 = Rectangle(Plane=PlaneXY(0, 0, 0), XSize=slot_width_2, YSize=slot_height_2, Radius=0)  # -> Rectangle, Length
slot_2 = Geometry(rectangle_2.Rectangle)
vector_xyz_2 = VectorXYZ(XComponent=multiplication_2, YComponent=subtraction_2, ZComponent=0)  # -> Vector, Length
move_2 = Move(Geometry=slot_2, Motion=vector_xyz_2.Vector)  # -> Geometry, Transform
number_of_slots_2 = Slider(3, range=0..10)
polar_array_2 = PolarArray(Geometry=move_2.Geometry, Plane=PlaneXY(0, 0, 0), Count=number_of_slots_2, Angle=6.283185307)  # -> Geometry, Transform
main_circle_2 = Geometry(circle_2)
slots_2 = Geometry(polar_array_2.Geometry)
region_difference_2 = RegionDifference(CurvesA=main_circle_2, CurvesB=slots_2)
final_2 = Geometry(region_difference_2)

# ----
x_3 = Slider(2, range=0..5)
multiplication_3 = Multiplication(A=slot_width, B=x_3)
rectangle_3 = Rectangle(Plane=PlaneXY(0, 0, 0), XSize=slot_width, YSize=slot_height, Radius=0)  # -> Rectangle, Length
number_of_slots_3 = Slider(3, range=0..10)
polar_array_3 = PolarArray(Geometry=move.Geometry, Plane=PlaneXY(0, 0, 0), Count=number_of_slots_3, Angle=6.283185307)  # -> Geometry, Transform
value_list = ValueList({"pi", "pi/2"}, selected="pi")
rotate = Rotate(Geometry=final_2, Angle=value_list, Plane=PlaneXY(0, 0, 0))  # -> Geometry, Transform
region_difference_3 = RegionDifference(CurvesA=final, CurvesB=rotate.Geometry)
region_intersection = RegionIntersection(CurvesA=final, CurvesB=rotate.Geometry)

# ---- group: shift preview
md_slider = MDSlider(
    SliderMode=0,
    slider_value=Point(0.567424495, 0.6099432969, 0.5),
    x_domain=Domain(-10, 10),
    y_domain=Domain(-10, 10),
    z_domain=Domain(0, 1))
move_3 = Move(Geometry=region_intersection, Motion=md_slider)  # -> Geometry, Transform
preview = Geometry(move_3.Geometry)
