# Grasshopper definition leaf.gh (Grasshopper 1.0.7)

# ---- group: settings - note this file needs to be opened with a2-parts.3dm
leaf_radius = Slider(1, range=0..5)
slot_width = Slider(0.112, range=0..5)
value = ValueList({"0.12", "0.25", "0.5", "1", "2", "3", "4", "5"}, selected="0.25")
circle_radius = Number(leaf_radius)
slot_height = Number(value)
slot_width_2 = Number(slot_width)
unit_leaf = Geometry(<curve referenced from the Rhino model>)

# ----
value_2 = ValueList({"0.12", "0.25", "0.5", "1", "2", "3", "4", "5"}, selected="1")
value_3 = ValueList({"0.12", "0.25", "0.5", "1", "2", "3", "4", "5"}, selected="1")

# ---- group: leaf with overlapped slots / overlapped slots
value_4 = ValueList({"-2", "0.12", "0.25", "1", "2", "3", "4", "5"}, selected="-2")
rectangle = Rectangle(Plane=PlaneXY(0, 0, 0), XSize=slot_width_2, YSize=slot_height, Radius=0)  # -> Rectangle, Length
subtraction = Subtraction(A=circle_radius, B=slot_height)
division = Division(A=slot_width_2, B=value_4)
vector_xyz = VectorXYZ(XComponent=division, YComponent=0, ZComponent=0)  # -> Vector, Length
vector_xyz_2 = VectorXYZ(XComponent=0, YComponent=subtraction, ZComponent=0)  # -> Vector, Length
slot = Geometry(rectangle.Rectangle)
value_5 = ValueList({"-2", "0", "0.12", "0.25", "1", "2", "3", "4", "5", "-pi/12", "pi/8", "pi/4", "3*pi/8", "5*pi/12", "7*pi/16", "pi/2", "3*pi/4", "pi", "5*pi/4", "3*pi/2", "7*pi/4", "2*pi", "pi/3"}, selected="pi/3")
value_6 = ValueList({"-2", "0.12", "0.25", "1", "2", "3", "4", "5", "2 pi": 2*pi, "pi", "pi/2", "2*pi/3", "pi/3", "pi/4", "pi/6"}, selected="2*pi/3")
value_7 = ValueList({"-2", "0.12", "0.25", "1", "2", "3", "4", "5"}, selected="2")
move = Move(Geometry=slot, Motion=vector_xyz.Vector)  # -> Geometry, Transform
move_2 = Move(Geometry=move.Geometry, Motion=vector_xyz_2.Vector)  # -> Geometry, Transform
polar_array = PolarArray(Geometry=move_2.Geometry, Plane=PlaneXY(0, 0, 0), Count=value_7, Angle=value_6)  # -> Geometry, Transform
rotate = Rotate(Geometry=polar_array.Geometry, Angle=value_5, Plane=PlaneXY(0, 0, 0))  # -> Geometry, Transform
overlapping_slots = Geometry(rotate.Geometry)

# ---- group: leaf with overlapped slots / leaf split
value_8 = ValueList({"-2", "-1", "0.12", "0.25", "1", "2", "3", "4", "5", "pi/8", "pi/4", "3*pi/8", "pi/2", "3*pi/4", "pi", "5*pi/4", "3*pi/2", "7*pi/4", "2*pi"}, selected="-1")
division_2 = Division(A=circle_radius, B=value_8)
vector_xyz_3 = VectorXYZ(XComponent=division_2, YComponent=0, ZComponent=0)  # -> Vector, Length
origin = Geometry(<point referenced from the Rhino model>)
line = Line(StartPoint=origin, EndPoint=vector_xyz_3.Vector)
split = Geometry(line)

# ----
did_u_fuck_up = BooleanToggle(True)

# ---- group: leaf with overlapped slots / trimmed leaf score
value_9 = ValueList({"-2", "0.12", "0.25", "1", "2", "3", "4", "5", "6", "10"}, selected="2")
multiplication = Multiplication(A=value_9, B=circle_radius)
vector_xyz_4 = VectorXYZ(XComponent=multiplication, YComponent=0, ZComponent=0)  # -> Vector, Length
origin_2 = Geometry(<point referenced from the Rhino model>)
line_2 = Line(StartPoint=origin_2, EndPoint=vector_xyz_4.Vector)
value_10 = ValueList({"-2", "0.12", "0.25", "1", "2", "3", "4", "5", "6"}, selected="6")
polar_array_2 = PolarArray(Geometry=line_2, Plane=PlaneXY(0, 0, 0), Count=value_10, Angle=6.283185307)  # -> Geometry, Transform

# ---- group: backup leaf.... just in case / leaf slots
value_11 = ValueList({"-2", "0.12", "0.25", "1", "2", "3", "4", "5"}, selected="-2")
rectangle_2 = Rectangle(Plane=PlaneXY(0, 0, 0), XSize=value_2, YSize=slot_width_2, Radius=0)  # -> Rectangle, Length
rectangle_3 = Rectangle(Plane=PlaneXY(0, 0, 0), XSize=slot_width_2, YSize=value_3, Radius=0)  # -> Rectangle, Length
division_3 = Division(A=slot_width_2, B=value_11)
vector_xyz_5 = VectorXYZ(XComponent=division_3, YComponent=0, ZComponent=0)  # -> Vector, Length
slot_2 = Geometry(rectangle_3.Rectangle)
value_12 = ValueList({"7*pi/6"}, selected="7*pi/6")
value_13 = ValueList({"-2", "0.12", "0.25", "1", "2", "3", "4", "5", "2 pi": 2*pi, "pi", "pi/2", "2*pi/3", "pi/3", "4*pi/3", "pi/4", "pi/6"}, selected="2 pi")
value_14 = ValueList({"-2", "0.12", "0.25", "1", "2", "3", "4", "5"}, selected="3")
vector_xyz_6 = VectorXYZ(XComponent=Slider(1.2, range=0..2), YComponent=division_3, ZComponent=0)  # -> Vector, Length
move_3 = Move(Geometry=slot_2, Motion=vector_xyz_5.Vector)  # -> Geometry, Transform
move_4 = Move(Geometry=rectangle_2.Rectangle, Motion=vector_xyz_6.Vector)  # -> Geometry, Transform

# ---- group: backup leaf.... just in case
value_15 = ValueList({"-2", "0.12", "0.25", "1", "2", "3", "4", "5"}, selected="0.25")

# ---- group: backup leaf.... just in case / leaf slots (continued)
subtraction_2 = Subtraction(A=circle_radius, B=value_15)
vector_xyz_7 = VectorXYZ(XComponent=0, YComponent=subtraction_2, ZComponent=0)  # -> Vector, Length
move_5 = Move(Geometry=move_3.Geometry, Motion=vector_xyz_7.Vector)  # -> Geometry, Transform
polar_array_3 = PolarArray(Geometry=move_5.Geometry, Plane=PlaneXY(0, 0, 0), Count=value_14, Angle=value_13)  # -> Geometry, Transform
rotate_2 = Rotate(Geometry=polar_array_3.Geometry, Angle=value_12, Plane=PlaneXY(0, 0, 0))  # -> Geometry, Transform
regular_slots = Geometry(rotate_2.Geometry)
merge = Merge(Data1=regular_slots, Data2=move_4.Geometry)

# ---- group: backup leaf.... just in case / outer leaf cut
scale = Scale(Geometry=unit_leaf, Center=Point(0, 0, 0), Factor=circle_radius)  # -> Geometry, Transform
region_difference = RegionDifference(CurvesA=scale.Geometry, CurvesB=merge)
outer_leaf_cut = Geometry(region_difference)

# ---- group: backup leaf.... just in case (continued)
backup_leaf = Geometry(outer_leaf_cut)

# ---- group: leaf with overlapped slots / outer leaf cut
scale_2 = Scale(Geometry=unit_leaf, Center=Point(0, 0, 0), Factor=circle_radius)  # -> Geometry, Transform

# ---- group: leaf with overlapped slots
leaf_base = Geometry(scale_2.Geometry)
all_slots = Geometry(overlapping_slots)

# ---- group: leaf with overlapped slots / outer leaf cut (continued)
region_difference_2 = RegionDifference(CurvesA=leaf_base, CurvesB=all_slots)
merge_2 = Merge(Data1=region_difference_2, Data2=split)
outer_leaf_cut_2 = Geometry(merge_2)

# ---- group: leaf with overlapped slots / trimmed leaf score (continued)
trim_with_region = TrimWithRegion(Curve=polar_array_2.Geometry, Region=leaf_base)  # -> Inside, Outside
trimmed_leaf_score = Geometry(trim_with_region.Inside)

# ---- group: leaf with overlapped slots (continued)
merge_3 = Merge(Data1=outer_leaf_cut_2, Data2=trimmed_leaf_score)
split_leaf_preview = Geometry(merge_3)

# ----
merge_4 = Merge(Data1=split_leaf_preview)
final_leaf = Geometry(merge_4)

# ---- group: preview
md_slider = MDSlider(
    SliderMode=0,
    slider_value=Point(0.6317138672, 0.6542648688, 0.5),
    x_domain=Domain(-10, 10),
    y_domain=Domain(-10, 10),
    z_domain=Domain(0, 1))
move_6 = Move(Geometry=final_leaf, Motion=md_slider)  # -> Geometry, Transform
shifted_preview = Geometry(move_6.Geometry)
